# Grasshopper definition CSharpWIP.gh (Grasshopper 0.9.76)

curve = Curve(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)
curve_2 = Curve(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)
c_script = CSharpScript(A=curve, B=curve_2, x=Slider(20, range=0..50), l=Slider(15, range=0..100), y=Slider(353, range=0..1000))  # -> out, AOut, APoints, BPoints, End, CurveA, CurveB, Intersect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; inputs A: Curve, B: Curve, x: Int32, l: Int32, y: Int32
# ---------- c_script: C# ----------
    Curve a = A;
    Point3d[] pointsA;
    a.DivideByCount(x, true, out pointsA);

    Curve b = B;
    Point3d[] pointsB;
    b.DivideByCount(x, true, out pointsB);

    End = b.PointAtEnd;


    if(l > x - 1)
    {

      l = (x - 1);
      outs = String.Format("l index is bigger than the size of the x collection");

    }

    /*
    List<Point3d> pointList = new List<Point3d>();
    for( int i = 0; i < pointsA.Length; i++ )
    {
      pointList.Add(pointsA[i]);
    }
    //foreach(Point3d point in pointList){}
    */

    Point3d pt = new Point3d(pointsB[l]);
    Vector3d vec = new Vector3d(pt);
    Point3d ptO = new Point3d(a.PointAtEnd);
    Vector3d one = new Vector3d(ptO);
    vec -= one;

    a.Translate(vec);

    CurveA = a;
    CurveB = b;

    Rhino.Geometry.Intersect.CurveIntersections ci;
    ci = Rhino.Geometry.Intersect.Intersection.CurveCurve(a, b, 0.001, 0.001);
    Point3d[] intPts = new Rhino.Geometry.Point3d[ci.Count];

    for(int i = 0; i < ci.Count; i++)
    {

      intPts[i] = ci[i].PointA;

    }
    Intersect = intPts;

    if(ci.Count > 1)
    {
      
      Vector3d vO = new Vector3d(pointsA[l]);
      vec += vO;
      a.Translate(vec);

      Rhino.Geometry.Intersect.CurveIntersections c;
      c = Rhino.Geometry.Intersect.Intersection.CurveCurve(a, b, 0.001, 0.001);
      Point3d[] intPtsO = new Rhino.Geometry.Point3d[c.Count];

      for(int i = 0; i < c.Count; i++)
      {

        intPtsO[i] = c[i].PointA;

      }
      IntersectTwo = intPtsO;
      
      //Point3d p = new Point3d(ci[0].PointA);
      
      //Vector3d v = new Vector3d(p);
      
      /*
      Vector3d vO = new Vector3d(pointsA[l]);
      vec += vO;
      a.Translate(vec);
      */
      
      //Transform trans = Transform.Rotation(y, Vector3d.YAxis, p);
      //a.Rotate(y * (Math.PI / 180), v, p);
      

      outs = String.Format("More than one collision");
      //oner = v;

    }

    else if( ci.Count == 1 )
    {

      outs = String.Format("Only one collision");

    }

    APoints = pointsA;
    BPoints = pointsB;

    AOut = String.Format(a + "\n" + b);
# ---------- end c_script ----------
panel = Panel(c_script.oner)
panel_2 = Panel(c_script.outs)
point = Point(c_script.IntersectTwo)
point_2 = Point(c_script.BPoints)
curve_3 = Curve(c_script.CurveB)
point_3 = Point(c_script.Intersect)
point_4 = Point(c_script.APoints)
point_5 = Point(c_script.End)
curve_4 = Curve(c_script.CurveA)
vector = Vector(c_script.oner)
panel_3 = Panel(point_3)
panel_4 = Panel(point)
